# Grasshopper definition autoshatter.gh (Grasshopper 1.0.7)
# plug-ins: DSUtilities

pipeline = GeometryPipeline(
    GroupByLayer=False,
    GroupByType=False,
    IncludeHidden=True,
    IncludeLocked=True,
    LayerFilter="*Default",
    NameFilter="*",
    SublayerFiltering=True,
    TypeFilter=4)
crv = Curve(pipeline)
autoshatter = AutoShatter(Curves=crv, Tolerance=0.1)  # -> ShatteredCurves, ShatterPoints, AllCurves
_0_0 = Slider(1, range=0..1)
_0_1 = Slider(0.24, range=0..1)
_0_2 = Slider(1, range=0..1)
_1_0 = Slider(0, range=0..1)
_1_1 = Slider(0, range=0..1)
_1_2 = Slider(0, range=0..1)
_2_0 = Slider(0.5, range=0..1)
_2_1 = Slider(1, range=0..1)
_2_2 = Slider(0.5, range=0..1)
Z = UnitZ(Factor=Slider(0, range=-10..0))
crv_2 = Curve(autoshatter.AllCurves)
pt = Point(autoshatter.ShatterPoints)
crv_3 = Curve(autoshatter.ShatteredCurves)
ctrlsurf = ControlSurface(
    Generate=Button(),
    Curves=crv_2,
    Ucount=3,
    Vcount=3,
    SurfaceOffset=Z,
    MaximumValue="10",
    MinimumValue=0.1,
    CtrlValue=[_0_0, _0_1, _0_2, _1_0, _1_1, _1_2, _2_0, _2_1, _2_2],
    ShowSurface=True,
    TextScale=Slider(0.65, range=0.01..1))  # -> ControlSurface, Values
topo = Topologize(Curves=crv_2, Scale=1, Tolerance=0.1, OneBased=True)
panel = Panel(ctrlsurf.Values)
srf = Surface(ctrlsurf.ControlSurface)
panel_2 = Panel(topo)
Z_2 = UnitZ(Factor=panel)
move = Move(Geometry=crv_2, Motion=Z_2)  # -> Geometry, Transform
