# Grasshopper definition definesection.gh (Grasshopper 1.0.7)
# plug-ins: DSUtilities

pipeline = GeometryPipeline(
    GroupByLayer=False,
    GroupByType=False,
    IncludeHidden=True,
    IncludeLocked=True,
    LayerFilter="*Default",
    NameFilter="*",
    SublayerFiltering=True,
    TypeFilter=4)
_0_0 = Slider(0.5, range=0..1)
_0_1 = Slider(0.5, range=0..1)
_0_2 = Slider(0.32, range=0..1)
_1_0 = Slider(0.18, range=0..1)
_1_1 = Slider(0.5, range=0..1)
_1_2 = Slider(1, range=0..1)
_2_0 = Slider(0.5, range=0..1)
_2_1 = Slider(0.61, range=0..1)
_2_2 = Slider(0.77, range=0..1)
autoshatter = AutoShatter(Curves=pipeline, Tolerance=0.1)  # -> ShatteredCurves, ShatterPoints, AllCurves
ctrlsurfpoint = ControlSurfacePoint(
    Generate=Button(),
    Points=autoshatter.ShatterPoints,
    Ucount=3,
    Vcount=3,
    SurfaceOffset=Vector(0, 0, -1),
    MaximumValue=Slider(73, range=0..100),
    MinimumValue=-100,
    CtrlValue=[_0_0, _0_1, _0_2, _1_0, _1_1, _1_2, _2_0, _2_1, _2_2],
    ShowSurface=True,
    TextScale=5)  # -> ControlSurface, Values
Z = UnitZ(Factor=ctrlsurfpoint.Values)
move = Move(Geometry=autoshatter.ShatterPoints, Motion=Z)  # -> Geometry, Transform
